# Grasshopper definition mico-homo.gh (Grasshopper 1.0.8)
# plug-ins: MicroHomo, Compliance

crv = Curve([<curve referenced from the Rhino model> x21])
recgrid = Rectangular(Plane="1,1", SizeX="1", SizeY="1", ExtentX="99", ExtentY="99")  # -> Cells, Points
pt = Point(recgrid.Points)
incurves = PointInCurves(Point=pt, Curves=crv)  # -> flatten(Relationship), Index, Point
equals = Equality(FirstNumber=incurves.Relationship, SecondNumber="0")  # -> Equality, Inequality
num = Number(equals.Equality)
matrix = ConstructMatrix(Rows=Slider(100, range=0..100), Columns=Slider(100, range=0..100), Values=num)
panel = Panel("""1
0.3
1
1""")
homo = MicroHomoComponent(Dense=matrix, EMuLxLy=panel)  # -> Result, VolBulkShearPossion, Timing
comp = Compliance(Dense=matrix, Case="1")  # -> CV, DisplacementField, Timing
panel_2 = Panel(homo.VolBulkShearPossion)
panel_3 = Panel(comp.CV)
panel_4 = Panel(comp.Timing)
matrix_2 = DisplayMatrix(homo.Result)
panel_5 = Panel(homo.Timing)

srf4pt = _4PointSurface(CornerA="1,1", CornerB="1,100", CornerC="100,100", CornerD="100,1")
boundary = BoundarySurfaces(Edges=crv, UseTasks=True)
rdiff = RegionDifference(CurvesA=srf4pt, CurvesB=boundary)
boundary_2 = BoundarySurfaces(Edges=rdiff)
triminc = PointInTrim(Surface=boundary_2, UVPoint=pt)  # -> flatten(Inclusion)
num_2 = Number(triminc)

rec_2pt = Rectangle2Pt(Plane=PlaneXY(0, 0, 0), PointA="0.1, 0.1", PointB="20, 20", Radius=0)  # -> Rectangle, Length
boundary_3 = BoundarySurfaces(Edges=rec_2pt.Rectangle)
rdiff_2 = RegionDifference(CurvesA=rec_2pt.Rectangle)
boundary_4 = BoundarySurfaces(Edges=rdiff_2)
Z = UnitZ(Factor=Slider(1, range=0..1))
Z_2 = UnitZ(Factor=Slider(3, range=0..10))
extr = Extrude(Base=boundary_2, Direction=Z_2)
extr_2 = Extrude(Base=boundary_4, Direction=Z)
mesh = MeshBrep(
    Brep=extr_2,
    Settings={GridMaxCount=0, GridMinCount=16, JaggedSeams=False, MaxEdgeLength=0, MinEdgeLength=0.0001, MinTolerance=0, Refine=True, RefineAngle=0, RelativeTolerance=0.65, SimplePlanes=True, Tolerance=0})
materials = QueryModelMaterials(Name="Polished Steel", AutoUpdateState=True)
material = CreateMaterial(
    Diffuse=ColourSwatch(SwatchColor=RGB(205, 183, 108)),
    Specular=ColourSwatch(SwatchColor=RGB(167, 134, 156)),
    Emission=ColourSwatch(SwatchColor=RGB(10, 0, 84)),
    Transparency=Slider(0.1, range=0..1),
    Shine=Slider(4, range=0..5))
preview = CustomPreview(Geometry=mesh, Material=materials)
swatch = ColourSwatch(SwatchColor=RGBA(216, 212, 216, 221))
